# Grasshopper definition 00_import_.ghx (Grasshopper 1.0.7)

# ---- group: magenta_base_geometry
half_gap_between_elements = Slider(0.035, range=0..0.1)
small_section = Slider(0.08, range=0..0.1)
countx_grip = Slider(36, range=0..100)
county_grip = Slider(22, range=0..100)
ghpython_script = GhPythonScript(thickness=half_gap_between_elements, section=small_section, count_x=countx_grip, count_y=county_grip)  # -> out, rectangles, outline, grid; inputs count_x: Int32, count_y: Int32
# ---------- ghpython_script: Python ----------
import Rhino.Geometry as rg

rectangles = []
grid = []

for x in range(count_x):
    for y in range(count_y):
        px = thickness + 2*thickness*x + section*x
        py = thickness + 2*thickness*y + section*y
        p = rg.Point3d(px,py,0)
        pl = rg.Plane.WorldXY
        pl.Origin = p
        rec = rg.Rectangle3d(pl, section,section)
        rectangles.append(rec)
        
        brep = rg.Brep.CreatePlanarBreps(rec.ToNurbsCurve())[0]
    
        # Calculate the AreaMassProperties of the brep
        area_mass_props = rg.AreaMassProperties.Compute(brep)
    
        # Extract the centroid
        centroid = area_mass_props.Centroid
        grid.append(centroid)
        
outline = rg.Rectangle3d(rg.Plane.WorldXY, px + section + thickness, py + section + thickness)
# ---------- end ghpython_script ----------

# ----
ghpython_script_2 = GhPythonScript(file_name="kassel.txt", width=Slider(0.08, range=0..0.1))  # -> out, boxes, lines
# ---------- ghpython_script_2: Python ----------
import Rhino.Geometry as rg
import os
HERE = ghenv.LocalScope.ghdoc.Path
DATA = os.path.abspath(os.path.join(HERE, '..', '..', 'txt'))
file_path = DATA + "/" + file_name

with open(file_path, 'r') as file:
    txt_lines = file.readlines()

boxes = []
origin = []
x_axis = []
y_axis = []
length = []
lines = []

for line in txt_lines:
    if line.strip() and not line.startswith('----------'):
        parts = list(map(float, line.split()))
        if len(parts) == 6:
            p1 = rg.Point3d(*parts[:3])
            p2 = rg.Point3d(*parts[3:6])
            lines.append(rg.Line(p1,p2))
            length.append(p1.DistanceTo(p2))
            origin.append( 0.5 * (p1 + p2) )
            xaxis = p2 - p1
            x_axis.append(xaxis)
        elif len(parts) == 3:
            yaxis = rg.Vector3d(*parts[:])
            y_axis.append( yaxis )
            
for o,x,y,l in zip(origin,x_axis,y_axis,length):
    
    pl = rg.Plane(o, x, y)
    box = rg.Box(pl, 
        rg.Interval(-0.5*l,0.5*l),
        rg.Interval(-0.5*width,0.5*width), 
        rg.Interval(-0.5*width,0.5*width))
    boxes.append(box)
# ---------- end ghpython_script_2 ----------
geometry = Geometry(ghpython_script.outline)
panel = Panel(ghpython_script_2.boxes)
scale = Scale(Geometry=geometry, Center=Point(0, 0, 0), Factor=Slider(10, range=10..1000))  # -> Geometry, Transform
unit_x = UnitX(Factor=Slider(2, range=0..10))
original_boxes = Box(ghpython_script_2.boxes)

# ---- group: scaling factor to get rid of gap
addition = Addition(Half_gap=half_gap_between_elements, Section=small_section, Half_gap_2=half_gap_between_elements)
section = Data(small_section)
division = Division(A=section, B=addition)
panel_2 = Panel(division)

# ----
move = Move(Geometry=original_boxes, Motion=unit_x)  # -> Geometry, Transform
panel_3 = Panel(scale.Geometry)
deconstruct_brep = DeconstructBrep(Brep=original_boxes)  # -> Faces, Edges, Vertices
area = Area(Geometry=original_boxes)  # -> Area, Centroid
length = Length(Curve=deconstruct_brep.Edges)
sort_list = SortList(Keys=length, ValuesValuesA=deconstruct_brep.Edges)  # -> Keys, ValuesValuesA
list_item = ListItem(List=sort_list.ValuesValuesA, Index="-1", Wrap=True)  # -> flatten(Item)
list_item_2 = ListItem(List=sort_list.ValuesValuesA, Index="6", Wrap=True)  # -> flatten(Item)
construct_plane = ConstructPlane(Origin=area.Centroid, XAxis=list_item_2, YAxis=list_item)
ghpython_script_3 = GhPythonScript(input_plane=construct_plane, points=ghpython_script.grid, grid=ghpython_script.grid, sc_factor=division)  # -> out, a, new_grid; inputs input_plane: Plane, points: list of Point3d, grid: list of Point3d
# ---------- ghpython_script_3: Python ----------
import Rhino.Geometry as rg
import math
from copy import deepcopy

new_grid = []

for pt in grid: 
    xform = rg.Transform.Scale(rg.Point3d(0,0,0), sc_factor)
    new_pt = deepcopy(pt)
    new_pt.Transform(xform)
    new_grid.append(pt)


#snap origin to grid
min_squared_distance = float("inf")
for i, point in enumerate(points):
    squared_distance = (point.X - input_plane.Origin.X) ** 2 + (point.Y - input_plane.Origin.Y) ** 2
    if squared_distance < min_squared_distance:
        min_squared_distance = squared_distance
        closest_point = grid[i]

input_plane.Origin = rg.Point3d(closest_point.X, closest_point.Y, input_plane.Origin.Z)

a = input_plane
# ---------- end ghpython_script_3 ----------
data = Data(ghpython_script_3.a)

# ---- group: snap to grid + apply scale
ghpython_script_4 = GhPythonScript(input_plane=construct_plane, points=ghpython_script.grid, grid=ghpython_script.grid, sc_factor=division)  # -> out, a, new_grid; inputs input_plane: Plane, points: list of Point3d, grid: list of Point3d
# ---------- ghpython_script_4: Python ----------
import Rhino.Geometry as rg
import math


new_grid = []

for pt in grid: 
    xform = rg.Transform.Scale(rg.Point3d(0,0,0), sc_factor)
    pt.Transform(xform)
    new_grid.append(pt)


#snap origin to grid
min_squared_distance = float("inf")
for i, point in enumerate(points):
    squared_distance = (point.X - input_plane.Origin.X) ** 2 + (point.Y - input_plane.Origin.Y) ** 2
    if squared_distance < min_squared_distance:
        min_squared_distance = squared_distance
        closest_point = new_grid[i]

input_plane.Origin = rg.Point3d(closest_point.X, closest_point.Y, input_plane.Origin.Z)

a = input_plane
# ---------- end ghpython_script_4 ----------

# ----
tree_statistics = TreeStatistics(Tree=ghpython_script_4.new_grid)  # -> Paths, Length, Count
list_item_3 = ListItem(List=tree_statistics.Paths, Index=0, Wrap=True)
plane = Plane(ghpython_script_4.a)
tree_branch = TreeBranch(Tree=ghpython_script_4.new_grid, Path=list_item_3, MaintainPaths=True)  # -> flatten(Branch)
length_2 = Length(Curve=list_item)
rectangle = Rectangle(Plane=ghpython_script_4.new_grid, XSize="-0.04 to 0.04", YSize="-0.04 to 0.04", Radius=0)  # -> Rectangle, Length
ghpython_script_5 = GhPythonScript()  # -> out, a
# ---------- ghpython_script_5: Python ----------
print 10//3
# ---------- end ghpython_script_5 ----------
thickness = Data(half_gap_between_elements)
section_2 = Data(small_section)
division_2 = Division(A=section_2, B=2)

# ---- group: tentative
ghpython_script_6 = GhPythonScript(
    thickness=half_gap_between_elements,
    planes=plane,
    threshold=Slider(31, range=0..100),
    lengths=length_2,
    grid=ghpython_script.grid,
    section=small_section,
    sc_factor=division,
    z_tolerance=Slider(10, range=0..90))  # -> out, vertical, Y, X, v_lengths, x_lengths, y_lengths; inputs planes: list of Plane, lengths: list, grid: list of Point3d
# ---------- ghpython_script_6: Python ----------
import Rhino.Geometry as rg
import math

vertical = []
X = []
Y = []

v_lengths = []
x_lengths = []
y_lengths = []

def find_maximum_with_index(a, b, c):
    numbers = [a, b, c]
    max_value = max(numbers)
    max_index = numbers.index(max_value)
    return max_index



def closest_aligned_axis(pl):

    # Compute dot products with world axes
    dot_x = abs(rg.Vector3d.Multiply(rg.Vector3d.XAxis, pl.YAxis))  
    dot_y = abs(rg.Vector3d.Multiply(rg.Vector3d.YAxis, pl.YAxis)) 
    dot_z = abs(rg.Vector3d.Multiply(rg.Vector3d.ZAxis, pl.YAxis)) 
    
    # Calculate the angle between the box's Y-axis and the world Z-axis in degrees
    angle_to_z = math.degrees(math.acos(dot_z))
    
    # Determine the closest aligned axis according to tolerance
    if angle_to_z <= z_tolerance: 
        closest_axis=0
    elif dot_x >= dot_y:
        closest_axis=2
    else:
        closest_axis=1

    return closest_axis



#align elements with world_axes

for i,pl in enumerate(planes):
    closest_axis = closest_aligned_axis(pl)

    #check if the longest side is close to worldZ or -WorldZ, so if it's aligned with z (vertical)
    if closest_axis== 0:
        plane = rg.Plane.WorldYZ
        #fix so that they are flash to the ground
        plane.Origin = rg.Point3d(pl.Origin.X, pl.Origin.Y, lengths[i]/2)
        vertical.append(plane)
        v_lengths.append(lengths[i])
        
    #chech if the longest side is close to worldY or -WorldY (Y aligned - hor)
    elif closest_axis== 1:
        #make all planes the same
        if rg.Vector3d.VectorAngle(pl.XAxis, rg.Vector3d.XAxis) < math.radians(threshold) or rg.Vector3d.VectorAngle(pl.XAxis, -rg.Vector3d.XAxis)<math.radians(threshold):
            pl.XAxis = pl.ZAxis
        #check if it's horizontal
        if rg.Vector3d.VectorAngle(pl.YAxis, rg.Vector3d.YAxis) < math.radians(10) or rg.Vector3d.VectorAngle(pl.YAxis, -rg.Vector3d.YAxis) < math.radians(10):
            origin = pl.Origin
            pl = rg.Plane.WorldXY
            pl.Origin = rg.Point3d(origin.X, origin.Y, (origin.Z //(section+ 0.15*thickness))* (section) + 0.5 * section)
        else:
            #force x component to be 0
            xaxis = rg.Vector3d( 0, pl.XAxis.Y, pl.XAxis.Z)
            yaxis = rg.Vector3d( 0, pl.YAxis.Y, pl.YAxis.Z)
            pl = rg.Plane(pl.Origin, xaxis, yaxis)
        Y.append(pl)
        y_lengths.append(lengths[i])
        
    #chech if the longest side is close to worldX or -WorldX (X aligned - hor)
    else:
        #make all planes the same
        if rg.Vector3d.VectorAngle(pl.XAxis, rg.Vector3d.YAxis) < math.radians(threshold) or rg.Vector3d.VectorAngle(pl.XAxis, -rg.Vector3d.YAxis)<math.radians(threshold):
            pl.XAxis = pl.ZAxis
        #check if it's horizontal
        if rg.Vector3d.VectorAngle(pl.YAxis, rg.Vector3d.XAxis) < math.radians(10) or rg.Vector3d.VectorAngle(pl.YAxis, -rg.Vector3d.XAxis) < math.radians(10):
            origin = pl.Origin
            pl = rg.Plane.WorldXY
            pl.Rotate (math.radians(90), rg.Vector3d.ZAxis, pl.Origin)
            pl.Origin = rg.Point3d(origin.X, origin.Y, (origin.Z //(section+ 0.15*thickness))*(section) + 0.5 * section)
        else:
            #force y component to be 0
            xaxis = rg.Vector3d( pl.XAxis.X, 0, pl.XAxis.Z)
            yaxis = rg.Vector3d( pl.YAxis.X, 0, pl.YAxis.Z)
            pl = rg.Plane(pl.Origin, xaxis, yaxis)
        X.append(pl)
        x_lengths.append(lengths[i])
# ---------- end ghpython_script_6 ----------
center_box = CenterBox(Base=ghpython_script_6.X, X=division_2, Y=expr("0.5*x", ghpython_script_6.x_lengths), Z=division_2)
center_box_2 = CenterBox(Base=ghpython_script_6.Y, X=division_2, Y=expr("0.5*x", ghpython_script_6.y_lengths), Z=division_2)
center_box_3 = CenterBox(Base=ghpython_script_6.vertical, X=division_2, Y=expr("0.5*x", ghpython_script_6.v_lengths), Z=division_2)

# ----
multiplication = Multiplication(A=thickness, B=2)
addition_2 = Addition(A=division_2, B=thickness)
merge = Merge(Data1=ghpython_script_6.v_lengths, Data2=ghpython_script_6.x_lengths, Data3=ghpython_script_6.y_lengths)
geometry_2 = Geometry([center_box_3, center_box_2, center_box])
custom_preview = CustomPreview(Geometry=center_box, Material=ColourSwatch(SwatchColor=RGB(48, 255, 224)))
custom_preview_2 = CustomPreview(Geometry=center_box_3, Material=ColourSwatch(SwatchColor=RGB(255, 229, 0)))
custom_preview_3 = CustomPreview(Geometry=center_box_2, Material=ColourSwatch(SwatchColor=RGB(255, 48, 210)))
wood_section = Slider(0.24, range=0..1)

# ---- group: scaling factor to get rid of gap
tolerance = Slider(0.002, range=0..0.005)
section_3 = Data(small_section)
addition_3 = Addition(A=wood_section, B=tolerance)
division_3 = Division(A=addition_3, B=section_3)
scale_2 = Scale(Geometry=tree_branch, Center=Point(0, 0, 0), Factor=division_3)  # -> Geometry, Transform
panel_4 = Panel(division_3)
rectangle_2 = Rectangle(Plane=scale_2.Geometry, XSize=Domain(-0.12, 0.12), YSize=Domain(-0.12, 0.12), Radius=0)  # -> Rectangle, Length

# ----
merge_2 = Merge(Data1=ghpython_script_6.vertical, Data2=ghpython_script_6.Y, Data3=ghpython_script_6.X)
scale_3 = Scale(Geometry=merge_2, Center=Point(0, 0, 0), Factor=division_3)  # -> Geometry, Transform
length_3 = Number(merge)
ghpython_script_7 = GhPythonScript(l=length_3)  # -> out, a
# ---------- ghpython_script_7: Python ----------
if l < 1.8:
    a = 5
else:
    a = 10
# ---------- end ghpython_script_7 ----------
center_box_4 = CenterBox(Base=scale_3.Geometry, X=expr("x/2", wood_section), Y=expr("0.5*x", ghpython_script_7.a), Z=expr("x/2", wood_section))
list_length = ListLength(List=ghpython_script_6.vertical)
split_list = SplitList(List=center_box_4, Index=list_length)  # -> ListA, ListB
ghpython_script_8 = GhPythonScript(vertical=split_list.ListA, non_v=split_list.ListB)  # -> moved_elements; inputs vertical: list of Brep, non_v: list of Brep
# ---------- ghpython_script_8: Python ----------
__author__ = "marirena"

import rhinoscriptsyntax as rs
import Rhino.Geometry as rg


def move_breps_to_xy_plane(boxes):
    moved_breps = []
    max_move = 0
    
    for b in vertical:
        
        bounding_box = b.GetBoundingBox(True)
        
        # Get the minimum point of the bounding box (this point will be on the XY plane after the move)
        min_z = bounding_box.Min.Z
        
        
        translation_vector = rg.Vector3d(0, 0, -min_z)
        moved_box = b.Duplicate()
        moved_box.Translate(translation_vector)
        
        # Add the moved box to the list
        moved_breps.append(moved_box)
        
        if abs(min_z) > max_move:
            max_move = abs(min_z)
    
    return moved_breps, max_move



moved_breps, move_rest = move_breps_to_xy_plane(vertical)


translation_rest = rg.Vector3d(0, 0, move_rest)

moved_other_breps = []

for other_b in non_v:
    moved_other_b = other_b.Duplicate()
    moved_other_b.Translate(translation_rest)
    moved_other_breps.append(moved_other_b)

moved_elements= moved_breps + moved_other_breps
# ---------- end ghpython_script_8 ----------

geometry_3 = Geometry(ghpython_script_8)
